# Dynamo graph 2021_04-1_BIMACON_Inserir Interruptor ao lado de portas-Selecionar porta_R01_script.dyn "2021_04-1_BIMACON_Inserir Interruptor ao lado de portas-Selecionar porta_R01" (Dynamo 2.6.1.8786)
# packages: Rhythm 2023.4.2024, Sparrow 2021.2.1, Data-Shapes 2022.2.105, Clockwork for Dynamo 2.x 2.4.0, Orchid 2.6.8.6198, archi-lab.net 2023.213.1722

boolean = BoolSelector(true)

# group: ENTRADAS PARA O USUÁRIO
code_block = CodeBlock { "Inserção de Interruptor ao lado de porta"; }
file_path = Filename("..\..\..\..\..\05 - BIMACON\01 - EMPRESA BIMACON\00 - Logos e imagens - BIMACON\ARTE BIMACON\reddonda-removebg-preview.png")
file_from_path = FileObject(path=file_path)
readFromFile = Image.ReadFromFile(file=file_from_path)
string = StringInput("Confirmar")
string_2 = StringInput("Selecione a Porta")
string_3 = StringInput("Selecione ")
categories = Categories("OST_Doors")
selectmodelelements_data = Custom[SelectModelElements Data](InputName=string_2, ButtonText=string_3, CategoryFilter=categories, SelectSingleElement=boolean)  # package Data-Shapes; Creates a Revit element selection input for UI.MultipleInputForm++ . Check out www.data-shapes.net for more infos!
string_4 = StringInput("Selecione o Espaço")
string_5 = StringInput("Selecione ")
categories_2 = Categories("OST_MEPSpaces")
boolean_2 = BoolSelector(true)
selectmodelelements_data_2 = Custom[SelectModelElements Data](InputName=string_4, ButtonText=string_5, CategoryFilter=categories_2, SelectSingleElement=boolean_2)
string_6 = StringInput("Tipo de Interruptor")
categories_3 = Categories("OST_LightingDevices")
all_families_of_category = Custom[All Families Of Category](category=categories_3)  # package Clockwork for Dynamo 2.x; Gets all famiies of a given category in the model (does *not *work for system families)
name = Family.Name(family=all_families_of_category)
code_block_2 = CodeBlock { "Interruptor"; }
contains = String.Contains(str=name, searchFor=code_block_2)
filterByBoolMask = List.FilterByBoolMask(list=all_families_of_category, mask=contains)
name_2 = Family.Name(family=filterByBoolMask.in)
code_block_3 = CodeBlock { "x."; }
contains_2 = String.Contains(str=name_2, searchFor=code_block_3)
filterByBoolMask_2 = List.FilterByBoolMask(list=filterByBoolMask.in, mask=contains_2)
types = Family.Types(family=filterByBoolMask_2.out)
flatten = List.Flatten(list=types)
family = FamilyType.Family(familyType=flatten)
name_3 = Family.Name(family=family)
code_block_4 = CodeBlock { "_"; }
split = String.Split(str=name_3, separator0=code_block_4)
code_block_5 = CodeBlock { 1; 2; }
getItemAtIndex = List.GetItemAtIndex(list=split@L2, index=code_block_5.out0)
getItemAtIndex_2 = List.GetItemAtIndex(list=split@L2, index=code_block_5.out1)
code_block_6 = CodeBlock(x=getItemAtIndex, y=getItemAtIndex_2) { x+" "+y; }
name_4 = FamilyType.Name(familyType=flatten)
code_block_7 = CodeBlock(a=code_block_6, b=name_4) { a; b; a+" : "+b; }
code_block_8 = CodeBlock { 8; }
dropdown_data = Custom[DropDown Data](InputName=string_6, Keys=code_block_7.out2, Values=flatten, DefaultValueIndex=code_block_8)  # package Data-Shapes; Create data for DropDown input in UI.MultiInputForm ++ . Check out www.data-shapes.net for more infos.
string_7 = StringInput("Distância do Eixo da Porta (Aprox. Larg. da Porta - 20cm)")
string_8 = StringInput("0.5")
boolean_3 = BoolSelector(true)
textbox_data = Custom[TextBox Data](InputName=string_7, DefaultText=string_8, IsNumberEntry=boolean_3)  # package Data-Shapes; Create Data for TextBox input in UI.MultipleInputForm ++ . Check out www.data-shapes.net for more informations
string_9 = StringInput("Inverter Lado em relação a Porta")
boolean_4 = BoolSelector(true)
string_10 = StringInput("Inverter Lado")
boolean_input = Custom[Boolean input](InputName=string_9, DefaultValue=boolean_4, SideText=string_10)  # package Data-Shapes; Creates a boolean input for UI.MultipleInputForm ++ . Check out www.data-shapes.net for more infos!
string_11 = StringInput("Elevação do Ponto")
string_12 = StringInput("1.2")
boolean_5 = BoolSelector(true)
textbox_data_2 = Custom[TextBox Data](InputName=string_11, DefaultText=string_12, IsNumberEntry=boolean_5)
list_create = List.Create(item0=selectmodelelements_data, item1=selectmodelelements_data_2, item2=dropdown_data, item3=textbox_data, item4=boolean_input, item5=textbox_data_2)
boolean_6 = BoolSelector(true)
string_13 = StringInput("Cancelar")
number = DoubleInput(500)
number_2 = DoubleInput(167)
multipleinputform = Custom[MultipleInputForm ++](Description_optional=code_block, Logo_optional=readFromFile, ButtonText_optional=string, Inputs=list_create, Toggle=boolean_6, CancelButtonText_optional=string_13, Width_optional=number, LabelWidth_optional=number_2)  # package Data-Shapes; Create a form with multiple inputs. see www.data-shapes.net for tutorials and infos!
code_block_9 = CodeBlock()  # //Data-Shapes
code_block_10 = CodeBlock()  # //archilab

# group: Separar Entradas
code_block_11 = CodeBlock { 4; }
getItemAtIndex_3 = List.GetItemAtIndex(list=multipleinputform.User_Inputs, index=code_block_11)
code_block_12 = CodeBlock { 1; }
getItemAtIndex_4 = List.GetItemAtIndex(list=multipleinputform.User_Inputs, index=code_block_12)
code_block_13 = CodeBlock { 0; }
getItemAtIndex_5 = List.GetItemAtIndex(list=multipleinputform.User_Inputs, index=code_block_13)
code_block_14 = CodeBlock { 3; }
getItemAtIndex_6 = List.GetItemAtIndex(list=multipleinputform.User_Inputs, index=code_block_14)
code_block_15 = CodeBlock { 2; }
getItemAtIndex_7 = List.GetItemAtIndex(list=multipleinputform.User_Inputs, index=code_block_15)
code_block_16 = CodeBlock { 5; }
getItemAtIndex_8 = List.GetItemAtIndex(list=multipleinputform.User_Inputs, index=code_block_16)

finishBoundary = Space.FinishBoundary(space=getItemAtIndex_4)
byJoinedCurves = PolyCurve.ByJoinedCurves(curves=finishBoundary)
reverse = Curve.Reverse(curve=byJoinedCurves)
if_ = If(test=getItemAtIndex_3, true=reverse, false=byJoinedCurves)
code_block_17 = CodeBlock { "Largura"; }
ʳʰʸᵗʰᵐ_elements = Rhythm.Revit.Elements.Elements.GetParameterValueByNameTypeOrInstance(element=getItemAtIndex_5, parameterName=code_block_17)
code_block_18 = CodeBlock(a=ʳʰʸᵗʰᵐ_elements, c=getItemAtIndex_6) { a; b=a/2; c; d=b+c; }
length = Curve.Length(curve=if_)
getLocation = Element.GetLocation(element=getItemAtIndex_5)
closestPointTo = Geometry.ClosestPointTo(geometry=if_, other=getLocation)
parameterAtPoint = Curve.ParameterAtPoint(curve=if_, point=closestPointTo)
code_block_19 = CodeBlock(offset_1=code_block_18.d, lenght_1=length, pap_1=parameterAtPoint) { par_1 = offset_1/lenght_1; par_2 = pap_1+par_1; pap_1; }
number_3 = DoubleInput(1)
add = code_block_19.par_2 + number_3  # lacing=Longest
code_block_20 = CodeBlock(x=add) { x>=1; x-1; x; }
if_2 = If(test=code_block_20.out0, true=code_block_20.out1, false=code_block_20.x)
pointAtParameter = Curve.PointAtParameter(curve=if_, param=if_2, lacing=Longest)
normalAtParameter = Curve.NormalAtParameter(curve=if_, param=if_2, lacing=Longest)
code_block_21 = CodeBlock { 1; }
byStartPointDirectionLength = Line.ByStartPointDirectionLength(startPoint=pointAtParameter, direction=normalAtParameter, length=code_block_21)
family_2 = FamilyType.Family(familyType=getItemAtIndex_7)
types_2 = Family.Types(family=family_2)
name_5 = FamilyType.Name(familyType=getItemAtIndex_7)
name_6 = FamilyType.Name(familyType=types_2)
eq = name_5 == name_6
filterByBoolMask_3 = List.FilterByBoolMask(list=types_2, mask=eq)
element_getLevel = Custom[element_getLevel](element=getItemAtIndex_5)  # package Sparrow; This node retrieves the host level from Revit elements.
byPointAndLevel = FamilyInstance.ByPointAndLevel(familyType=filterByBoolMask_3.in, point=pointAtParameter, level=element_getLevel, lacing=Longest)
string_14 = StringInput("Elevação do nível")
code_block_22 = CodeBlock { 0; }
setParameterByName = Element.SetParameterByName(element=byPointAndLevel, parameterName=string_14, value=code_block_22, lacing=Longest)
string_15 = StringInput("Elevação do Ponto")
setParameterByName_2 = Element.SetParameterByName(element=setParameterByName, parameterName=string_15, value=getItemAtIndex_8, lacing=Longest)
reverse_2 = Vector.Reverse(vector=normalAtParameter)
if_3 = If(test=getItemAtIndex_3, true=normalAtParameter, false=reverse_2)
YAxis = Vector.YAxis()
ZAxis = Vector.ZAxis()
angleAboutAxis = Vector.AngleAboutAxis(vector=if_3, otherVector=YAxis, rotationAxis=ZAxis)
setRotation = FamilyInstance.SetRotation(familyInstance=setParameterByName_2, degree=angleAboutAxis)
passThrough = Custom[PassThrough](passThrough=setRotation, waitFor=setRotation)  # package archi-lab.net; Ripped this off from Clockwork. Sorry Andy.

# group: Mensagem final
count = List.Count(list=passThrough)
code_block_23 = CodeBlock { 0; }
gt = count > code_block_23
code_block_24 = CodeBlock(N=count) { ["Feito! Você inseriu "+N+" Interruptor em seu projeto"]; }
code_block_25 = CodeBlock { ["Nenhum interruptor foi inserido"]; }
if_4 = If(test=gt, true=code_block_24, false=code_block_25)
flatten_2 = List.Flatten(list=if_4)
o_string_fromlist = Orchid.Common.String.FromList(list=flatten_2)
python_script = Python(IN[0]=o_string_fromlist)
# ---------- python_script.python (21 lines) ----------
# Importar as bibliotecas necessárias do Revit
import clr
clr.AddReference("RevitServices")
from RevitServices.Persistence import DocumentManager

clr.AddReference("RevitAPI")
clr.AddReference("RevitAPIUI")
from Autodesk.Revit.UI import TaskDialog

# Pegar a entrada do Dynamo
mensagem = IN[0]

# Criar a TaskDialog
task_dialog = TaskDialog("Ok")
task_dialog.MainInstruction = mensagem

# Exibir a TaskDialog
task_dialog.Show()

# Saída do script
OUT = "Sucesso!"
# ----------------------------------------
