# Dynamo graph ok 2021_06-1_BIMACON_Inserir Luvas em eletrodutos verticais por seleção_R03_script.dyn "2021_06-1_BIMACON_Inserir Luvas em eletrodutos verticais por seleção_R02" (Dynamo 2.6.1.8786)
# packages: Clockwork for Dynamo 1.x 1.0.2, MEPover 2022.10.30, archi-lab.net 2023.213.1722, bimorphNodes 4.2.4, DynaMEP 2.0.1, Data-Shapes 2022.2.105, Genius Loci 2023.2.21

# group: INPUT
elevação_inferior_mínima_m = DoubleInput(2.5)

# group: ENTRADAS PARA O USUÁRIO
code_block = CodeBlock { "Inserção de Luva por seleção"; }
file_path = Filename("..\..\..\..\..\05 - BIMACON\01 - EMPRESA BIMACON\00 - Logos e imagens - BIMACON\ARTE BIMACON\reddonda-removebg-preview.png")
file_from_path = FileObject(path=file_path)
readFromFile = Image.ReadFromFile(file=file_from_path)
string = StringInput("Confirmar")
string_2 = StringInput("Selecione o Eletroduto")
string_3 = StringInput("Selecione")
categories = Categories("OST_Conduit")
boolean = BoolSelector(true)
selectmodelelements_data = Custom[SelectModelElements Data](InputName=string_2, ButtonText=string_3, CategoryFilter=categories, SelectSingleElement=boolean)  # package Data-Shapes; Creates a Revit element selection input for UI.MultipleInputForm++ . Check out www.data-shapes.net for more infos!
string_4 = StringInput("Altura da Luva")
string_5 = StringInput("2.6")
boolean_2 = BoolSelector(true)
textbox_data = Custom[TextBox Data](InputName=string_4, DefaultText=string_5, IsNumberEntry=boolean_2)  # package Data-Shapes; Create Data for TextBox input in UI.MultipleInputForm ++ . Check out www.data-shapes.net for more informations
string_6 = StringInput("Elevação Superior Máxima (m) Dica: Pegue a Elevação Intermediária dos Eletrodutos na Laje.")
string_7 = StringInput("2.9")
boolean_3 = BoolSelector(true)
textbox_data_2 = Custom[TextBox Data](InputName=string_6, DefaultText=string_7, IsNumberEntry=boolean_3)
list_create = List.Create(item0=selectmodelelements_data, item1=textbox_data, item2=textbox_data_2)
boolean_4 = BoolSelector(true)
string_8 = StringInput("Cancelar")
number = DoubleInput(450)
number_2 = DoubleInput(175)
multipleinputform = Custom[MultipleInputForm ++](Description_optional=code_block, Logo_optional=readFromFile, ButtonText_optional=string, Inputs=list_create, Toggle=boolean_4, CancelButtonText_optional=string_8, Width_optional=number, LabelWidth_optional=number_2)  # package Data-Shapes; Create a form with multiple inputs. see www.data-shapes.net for tutorials and infos!
code_block_2 = CodeBlock()  # //Data-Shapes
code_block_3 = CodeBlock()  # //archilab

# group: Separar Entradas
code_block_4 = CodeBlock { 0; }
getItemAtIndex = List.GetItemAtIndex(list=multipleinputform.User_Inputs, index=code_block_4)
code_block_5 = CodeBlock { 2; }
getItemAtIndex_2 = List.GetItemAtIndex(list=multipleinputform.User_Inputs, index=code_block_5)
code_block_6 = CodeBlock { 1; }
getItemAtIndex_3 = List.GetItemAtIndex(list=multipleinputform.User_Inputs, index=code_block_6)

# group: Elementos a serem cortados
code_block_7 = CodeBlock { "Elevação superior"; }
getParameterValueByName = Element.GetParameterValueByName(element=getItemAtIndex, parameterName=code_block_7)
code_block_8 = CodeBlock(alturainf=elevação_inferior_mínima_m, Value=getParameterValueByName, elem=getItemAtIndex) { alturainf; Value >=alturainf ? elem : null; false; }
clean = List.Clean(list=code_block_8.out1, preserveIndices=code_block_8.out2)
code_block_9 = CodeBlock(alturasup=getItemAtIndex_2, Value=getParameterValueByName, elem=getItemAtIndex) { alturasup; Value <=alturasup ? elem : null; false; }
clean_2 = List.Clean(list=code_block_9.out1, preserveIndices=code_block_9.out2)
setIntersection = List.SetIntersection(list1=clean, list2=clean_2)

mep_connector_info = Custom[MEP Connector info+](element=setIntersection)  # package MEPover; This node will return the connectors and a lot of information about those connectors of the input elements
element_level = Custom[Element Level](element=getItemAtIndex)  # package Genius Loci; Gets an element's level. Based on a Clockwork's node

# group: Selecionar curvas
name = Element.Name(element=mep_connector_info.ConnectedElements)
string_9 = StringInput("Curva generica")
boolean_5 = BoolSelector(true)
contains = String.Contains(str=name, searchFor=string_9, ignoreCase=boolean_5)
filterByBoolMask = List.FilterByBoolMask(list=mep_connector_info.ConnectedElements, mask=contains)
string_10 = StringInput("Nível")
getParameterValueByName_2 = Element.GetParameterValueByName(element=filterByBoolMask.in, parameterName=string_10)
name_2 = Level.Name(level=getParameterValueByName_2)
name_3 = Level.Name(level=element_level)
eq = name_2 == name_3
filterByBoolMask_2 = List.FilterByBoolMask(list=filterByBoolMask.in, mask=eq)
string_11 = StringInput("Elevação do nível")
getParameterValueByName_3 = Element.GetParameterValueByName(element=filterByBoolMask_2.in, parameterName=string_11)
gt = getParameterValueByName_3 > getItemAtIndex_2
filterByBoolMask_3 = List.FilterByBoolMask(list=filterByBoolMask_2.in, mask=gt)
boolean_6 = BoolSelector(false)
clean_3 = List.Clean(list=filterByBoolMask_3.in, preserveIndices=boolean_6)
watch = Watch(clean_3)

# group: Comprimento e Subcomprimento
getLocation = Element.GetLocation(element=setIntersection, lacing=CrossProduct)
length = Curve.Length(curve=getLocation)

# group: Copia dos elementos
code_block_10 = CodeBlock { 1.5; }
div = length / code_block_10
ceiling = Math.Ceiling(number=div)
code_block_11 = CodeBlock(a=ceiling) { a>1; }
code_block_12 = CodeBlock { 2; }
code_block_13 = CodeBlock { 2; }
# note: Clockwork
if_ = If(test=code_block_11, true=code_block_12, false=code_block_13)
cycle = List.Cycle(list=setIntersection@L1, amount=if_@L1, lacing=Shortest)
byCoordinates = Vector.ByCoordinates()
copyByVector = Custom[Element.CopyByVector](element=cycle@@L1, vector=byCoordinates, lacing=Longest)  # package Clockwork for Dynamo 1.x; Copies an element or a list of elements by a given vector.
flatten = List.Flatten(list=copyByVector, lacing=Longest)

# group: Altura para corte do eletroduto
endPoint = Curve.EndPoint(curve=getLocation)
X = Point.X(point=endPoint)
Y = Point.Y(point=endPoint)
Z = Point.Z(point=endPoint)
code_block_14 = CodeBlock(a=Z) { a>1; }
maximumItem = List.MaximumItem(list=Z)
elevation = Level.Elevation(level=element_level)
code_block_15 = CodeBlock(a=maximumItem, b=getItemAtIndex_3, e=elevation) { a; b; c = a-b; d = a-c; e; f=d+e; }
if_2 = If(test=code_block_14, true=code_block_15.f, false=code_block_15.f)
byCoordinates_2 = Point.ByCoordinates(x=X, y=Y, z=if_2)
splitByPoints = Curve.SplitByPoints(curve=getLocation, points=byCoordinates_2, lacing=Shortest)
setLocation = Element.SetLocation(element=flatten, geometry=splitByPoints, lacing=Shortest)

# group: Unir conduite com conexão
code_block_16 = CodeBlock(waithFor=setLocation, Pass=flatten) { [waithFor,Pass][1]; }
code_block_17 = CodeBlock { -1; }
dropItems = List.DropItems(list=code_block_16, amount=code_block_17, lacing=Longest)
restOfItems = List.RestOfItems(list=code_block_16, lacing=Longest)
byMEPCurves = Custom[MEPFitting.ByMEPCurves](MEPCurve1=dropItems, MEPCurve2=restOfItems, lacing=Longest)  # package MEPover; Creates a UnionFitting or ElbowFitting by 2 MEPCurves (Ducts, Cable Trays, Pipes or Conduits). The output may not always be all the fittings created as Revit sometimes creates extra transition fittings outside of the node transactions.

# group: Selecionar eletroduto a conectar
list_create_2 = List.Create(item0=dropItems, item1=restOfItems)
passThrough = Custom[PassThrough](passThrough=list_create_2@L2, waitFor=byMEPCurves)  # package archi-lab.net; Ripped this off from Clockwork. Sorry Andy.
string_12 = StringInput("Elevação superior")
getParameterValueByName_4 = Element.GetParameterValueByName(element=passThrough, parameterName=string_12)
code_block_18 = CodeBlock { 0.12; }
sub = getItemAtIndex_2 - code_block_18
gt_2 = getParameterValueByName_4 > sub

boolean_7 = BoolSelector(false)
clean_4 = List.Clean(list=gt_2, preserveIndices=boolean_7)

# group (continued): Selecionar eletroduto a conectar
filterByBoolMask_4 = List.FilterByBoolMask(list=passThrough, mask=clean_4)

watch_2 = Watch(filterByBoolMask_4.in)
flatten_2 = List.Flatten(list=watch_2, lacing=Shortest)
watch_3 = Watch(mep_connector_info.ConnectedElements)
flatten_3 = List.Flatten(list=clean_3)

# group: Unir conduite da laje com da parede
mep_connector_info_2 = Custom[MEP Connector info+](element=flatten_3)
string_13 = StringInput("Elevação superior")
getParameterValueByName_5 = Element.GetParameterValueByName(element=mep_connector_info_2.ConnectedElements, parameterName=string_13)
gt_3 = getParameterValueByName_5 > getItemAtIndex_2
filterByBoolMask_5 = List.FilterByBoolMask(list=mep_connector_info_2.ConnectedElements, mask=gt_3)
watch_4 = Watch(mep_connector_info_2.ConnectedElements)

watch_5 = Watch(filterByBoolMask_5.in)

# group (continued): Unir conduite da laje com da parede
flatten_4 = List.Flatten(list=watch_5, lacing=Shortest)
solids = Element.Solids(element=flatten_4)
byMEPCurves_2 = Custom[MEPFitting.ByMEPCurves](MEPCurve1=watch_5, MEPCurve2=watch_2, lacing=CrossProduct)

# group: Deletar elemento obsoleto
# note: Archilab
code_block_19 = CodeBlock(waithFor=flatten, Pass=setIntersection) { [waithFor,Pass][1]; }
delete = archilab.Revit.Elements.Elements.Delete(element=code_block_19)

boolean_8 = BoolSelector(false)
clean_5 = List.Clean(list=filterByBoolMask_4.in, preserveIndices=boolean_8, lacing=Longest)

# group: Deletar elemento obsoleto
# note: Archilab
code_block_20 = CodeBlock(waithFor=clean_5, Pass=flatten_3) { [waithFor,Pass][1]; }
delete_2 = archilab.Revit.Elements.Elements.Delete(element=code_block_20)

flatten_5 = List.Flatten(list=byMEPCurves)
count = List.Count(list=flatten_5)
boolean_9 = BoolSelector(false)
clean_6 = List.Clean(list=byMEPCurves_2, preserveIndices=boolean_9)
flatten_6 = List.Flatten(list=clean_6)

# group: Conduites desconectados
code_block_21 = CodeBlock(waithFor=flatten_6, Pass=list_create_2) { [waithFor,Pass][1]; }
connectors = RevitModel.Element.Connectors(elements=code_block_21)
isConnected = MEP.Connectors.IsConnected(connector=connectors)
filterByBoolMask_6 = List.FilterByBoolMask(list=connectors, mask=isConnected)
flatten_7 = List.Flatten(list=filterByBoolMask_6.out)
owner = MEP.Connectors.Owner(connector=flatten_7)
flatten_8 = List.Flatten(list=filterByBoolMask_6.in)
owner_2 = MEP.Connectors.Owner(connector=flatten_8)

# group: Todas caixas
categories_2 = Categories("OST_ElectricalFixtures")
all_elements_of_category = ElementsOfCategory(Category=categories_2)
categories_3 = Categories("OST_LightingDevices")
all_elements_of_category_2 = ElementsOfCategory(Category=categories_3)
categories_4 = Categories("OST_ElectricalEquipment")
all_elements_of_category_3 = ElementsOfCategory(Category=categories_4)
list_create_3 = List.Create(item0=all_elements_of_category, item1=all_elements_of_category_2, item2=all_elements_of_category_3)
flatten_9 = List.Flatten(list=list_create_3)

# group: Selecionar caixas
location = MEP.Connectors.Location(connector=flatten_7)
code_block_22 = CodeBlock { 0.05; }
byCenterPointRadius = Sphere.ByCenterPointRadius(centerPoint=location, radius=code_block_22)
intersectsSolid = Revit.Element.IntersectsSolid(solids=byCenterPointRadius, elements=flatten_9)
intersectingElements = Results.SolidIntersectionResult.IntersectingElements(solidIntersectionResult=intersectsSolid)
boolean_10 = BoolSelector(true)
clean_7 = List.Clean(list=intersectingElements, preserveIndices=boolean_10)
firstItem = List.FirstItem(list=clean_7@L2)
boolean_11 = BoolSelector(false)
clean_8 = List.Clean(list=firstItem, preserveIndices=boolean_11)
flatten_10 = List.Flatten(list=clean_8)
uniqueItems = List.UniqueItems(list=flatten_10)
solids_2 = Element.Solids(element=uniqueItems)

code_block_23 = CodeBlock(waithFor=uniqueItems, Pass=owner) { [waithFor,Pass][1]; }
name_4 = Element.Name(element=uniqueItems)
code_block_24 = CodeBlock { "QDC"; }
contains_2 = String.Contains(str=name_4, searchFor=code_block_24)
filterByBoolMask_7 = List.FilterByBoolMask(list=uniqueItems, mask=contains_2)

# group: Conectar eletrodutos e caixas
list_create_4 = List.Create(item0=code_block_23, item1=filterByBoolMask_7.out)
flatten_11 = List.Flatten(list=list_create_4)
python_script = Python(IN[0]=flatten_11)
# ---------- python_script.python (73 lines) ----------
import clr

clr.AddReference("RevitServices")
import RevitServices
from RevitServices.Persistence import DocumentManager
from RevitServices.Transactions import TransactionManager
doc = DocumentManager.Instance.CurrentDBDocument

clr.AddReference("RevitAPI")
from Autodesk.Revit.DB import *

clr.AddReference("RevitNodes")
import Revit
clr.ImportExtensions(Revit.Elements)
clr.ImportExtensions(Revit.GeometryConversion)

def ConnectTo(connector, conn2):
    try:
        TransactionManager.Instance.EnsureInTransaction(doc)
        connector.ConnectTo(conn2)
        TransactionManager.Instance.TransactionTaskDone()
        return 1  # Retorna 1 para indicar uma conexão feita
    except:
        return 0  # Retorna 0 para indicar uma conexão não feita

conduits = UnwrapElement(IN[0])
margin = 0.01

connectors = {}
connlist = []
connections = 0  # Variável para armazenar o número de conexões feitas

for conduit in conduits:
    if conduit is None:
        continue

    try:
        conns = conduit.ConnectorManager.Connectors
    except AttributeError:
        try:
            conns = conduit.MEPModel.ConnectorManager.Connectors
        except AttributeError:
            continue

    for conn in conns:
        if conn.IsConnected:
            continue
        connectors[conn] = None
        connlist.append(conn)

for k in connectors.keys():
    mindist = 1000000
    closest = None
    for conn in connlist:
        if conn.Owner.Id.Equals(k.Owner.Id):
            continue
        dist = k.Origin.DistanceTo(conn.Origin)
        if dist < mindist:
            mindist = dist
            closest = conn
    if mindist > margin:
        continue
    connectors[k] = closest
    connlist.remove(closest)
    try:
        del connectors[closest]
    except:
        pass

for k, v in connectors.items():
    connections += ConnectTo(k, v)  # Incrementa a variável connections com o resultado da função ConnectTo

OUT = connections  # Saída com o número total de conexões feitas
# ----------------------------------------

solids_3 = Element.Solids(element=owner)
location_2 = Custom[Connector.Location](connector=flatten_7)  # package MEPover; Returns the location of a connector

# group: Selecionar caixa e pegar conector
connectors_2 = Custom[Element.Connectors](element=filterByBoolMask_7.in)  # package MEPover; Returns every connector on an element (also return connectors of a System)
connectorSystemType = Custom[Connector.ConnectorSystemType](connector=connectors_2)  # package MEPover; Returns the Connector System Type of the connector
isNull = Object.IsNull(obj=connectorSystemType, lacing=Longest)
filterByBoolMask_8 = List.FilterByBoolMask(list=connectors_2, mask=isNull)
isConnected_2 = Custom[Connector.IsConnected](connector=filterByBoolMask_8.in)  # package MEPover; Returns a boolean indicating whether the connector is connected to a connector on different element
filterByBoolMask_9 = List.FilterByBoolMask(list=filterByBoolMask_8.in, mask=isConnected_2)
code_block_25 = CodeBlock { "Superior"; }
description = MEP.Connectors.Description(connector=filterByBoolMask_9.out)
eq_2 = code_block_25 == description
filterByBoolMask_10 = List.FilterByBoolMask(list=filterByBoolMask_9.out@L1, mask=eq_2@L1, lacing=Shortest)
location_3 = Custom[Connector.Location](connector=filterByBoolMask_10.in)

flatten_12 = List.Flatten(list=location_3)
flatten_13 = List.Flatten(list=filterByBoolMask_10.in)

# group: Pegar conectores na mesma posição e conectar eletroduto a caixa
isAlmostEqualTo = Geometry.IsAlmostEqualTo(geometry=location_2, other=flatten_12, lacing=CrossProduct)
filterByBoolMask_11 = List.FilterByBoolMask(list=flatten_13@L2, mask=isAlmostEqualTo, lacing=Longest)

filterByBoolMask_12 = List.FilterByBoolMask(list=flatten_7@L2, mask=isAlmostEqualTo, lacing=Longest)
flatten_14 = List.Flatten(list=filterByBoolMask_12.in)
flatten_15 = List.Flatten(list=filterByBoolMask_11.in)
connectTo = Custom[Connector.ConnectTo](connector=flatten_14, Connector2=flatten_15, lacing=Longest)  # package MEPover; Connects a connector to another connector. Returns True if connection succeeded
