# Dynamo graph ok 2021_08-1_BIMACON_Inserir Suportes por Seleção_R05_script.dyn (Dynamo 2.6.1.8786)
# Inserção de Suportes por seleção em Eletrodutos e Bandeja de Cabos
# packages: bimorphNodes 4.2.4, Data-Shapes 2022.2.105, Clockwork for Dynamo 2.x 2.4.0

# group: Projeto
# note: Utilize esta cor para as funções desenhadas no programa (núcleo do gráfico)

# group: Entradas
# note: Use esta cor para os nós e blocos de código que representam as entradas

# group: Python
# note: Use esta cor para os nós Python

# group: Nome do Projeto: "Colocar suportes para caminhos de cabos"
# note: Este gráfico coloca o suporte das eletrocalhas dividido em distâncias iguais. Divirta-se!!!! :D :D :D

# group: Saída
# note: Use esta cor para os nós que representam a saída do gráfico

# group: PROBLEMAS PARA RESOLVER
# note: TENTANDO DESCOBRIR COMO RODAR TODAS AS FAMÍLIAS NA DIREÇÃO CORRETA.
# SUBPONTO: NÓ RAYBUNCE NÃO FUNCIONA COM encontrar o ponto mais próximo.??????

# group: ENTRADAS PARA O USUÁRIO
code_block = CodeBlock { "Inserção de Suportes em Eletrodutos ou eletrocalhas"; }
file_path = Filename("..\..\..\..\..\05 - BIMACON\01 - EMPRESA BIMACON\00 - Logos e imagens - BIMACON\ARTE BIMACON\reddonda-removebg-preview.png")
file_from_path = FileObject(path=file_path)
readFromFile = Image.ReadFromFile(file=file_from_path)
string = StringInput("Confirmar")
string_2 = StringInput("Selecione os Eletrodutos ou Bandeja de Cabos Depois clique em Concluir")
string_3 = StringInput("Selecione ")
categories = Categories("OST_Conduit")
categories_2 = Categories("OST_CableTray")
list_create = List.Create(item0=categories, item1=categories_2)
boolean = BoolSelector(false)
selectmodelelements_data = Custom[SelectModelElements Data](InputName=string_2, ButtonText=string_3, CategoryFilter=list_create, SelectSingleElement=boolean)  # package Data-Shapes; Creates a Revit element selection input for UI.MultipleInputForm++ . Check out www.data-shapes.net for more infos!
string_4 = StringInput("Tipo de Suporte")
categories_3 = Categories("OST_ConduitFitting")
all_families_of_category = Custom[All Families Of Category](category=categories_3)  # package Clockwork for Dynamo 2.x; Gets all famiies of a given category in the model (does *not *work for system families)
categories_4 = Categories("OST_CableTrayFitting")
all_families_of_category_2 = Custom[All Families Of Category](category=categories_4)
list_create_2 = List.Create(item0=all_families_of_category, item1=all_families_of_category_2)
boolean_2 = BoolSelector(false)
clean = List.Clean(list=list_create_2, preserveIndices=boolean_2)
flatten = List.Flatten(list=clean)
name = Family.Name(family=flatten)
code_block_2 = CodeBlock { "Suporte"; }
contains = String.Contains(str=name, searchFor=code_block_2)
filterByBoolMask = List.FilterByBoolMask(list=flatten, mask=contains)
types = Family.Types(family=filterByBoolMask.in)
flatten_2 = List.Flatten(list=types)
name_2 = FamilyType.Name(familyType=flatten_2)
code_block_3 = CodeBlock { "x"; }
boolean_3 = BoolSelector(true)
contains_2 = String.Contains(str=name_2, searchFor=code_block_3, ignoreCase=boolean_3)
filterByBoolMask_2 = List.FilterByBoolMask(list=flatten_2, mask=contains_2)
flatten_3 = List.Flatten(list=filterByBoolMask_2.out)
name_3 = FamilyType.Name(familyType=flatten_3)
name_4 = Family.Name(family=filterByBoolMask.in)
code_block_4 = CodeBlock { "Mao Francesa"; }
contains_3 = String.Contains(str=name_4, searchFor=code_block_4)
filterByBoolMask_3 = List.FilterByBoolMask(list=filterByBoolMask.in, mask=contains_3)
name_5 = Family.Name(family=filterByBoolMask_3.in)
types_2 = Family.Types(family=filterByBoolMask_3.in)
name_6 = Element.Name(element=types_2)
add = name_5 + name_6
flatten_4 = List.Flatten(list=add)
list_create_3 = List.Create(item0=name_3, item1=flatten_4)
flatten_5 = List.Flatten(list=list_create_3)
clean_2 = List.Clean(list=flatten_5)
flatten_6 = List.Flatten(list=types_2)
list_create_4 = List.Create(item0=flatten_3, item1=flatten_6)
flatten_7 = List.Flatten(list=list_create_4)
clean_3 = List.Clean(list=flatten_7)
code_block_5 = CodeBlock { 0; }
dropdown_data = Custom[DropDown Data](InputName=string_4, Keys=clean_2, Values=clean_3, DefaultValueIndex=code_block_5)  # package Data-Shapes; Create data for DropDown input in UI.MultiInputForm ++ . Check out www.data-shapes.net for more infos.
string_5 = StringInput("Distancia inicial primeiro Suporte (m)")
string_6 = StringInput("0.2")
boolean_4 = BoolSelector(true)
textbox_data = Custom[TextBox Data](InputName=string_5, DefaultText=string_6, IsNumberEntry=boolean_4)  # package Data-Shapes; Create Data for TextBox input in UI.MultipleInputForm ++ . Check out www.data-shapes.net for more informations
string_7 = StringInput("Espaçamento entre Suportes (m)")
string_8 = StringInput("1")
boolean_5 = BoolSelector(true)
textbox_data_2 = Custom[TextBox Data](InputName=string_7, DefaultText=string_8, IsNumberEntry=boolean_5)
list_create_5 = List.Create(item0=selectmodelelements_data, item1=dropdown_data, item2=textbox_data, item3=textbox_data_2)
boolean_6 = BoolSelector(true)
string_9 = StringInput("Cancelar")
number = DoubleInput(650)
number_2 = DoubleInput(167)
multipleinputform = Custom[MultipleInputForm ++](Description_optional=code_block, Logo_optional=readFromFile, ButtonText_optional=string, Inputs=list_create_5, Toggle=boolean_6, CancelButtonText_optional=string_9, Width_optional=number, LabelWidth_optional=number_2)  # package Data-Shapes; Create a form with multiple inputs. see www.data-shapes.net for tutorials and infos!
code_block_6 = CodeBlock()  # //Data-Shapes
code_block_7 = CodeBlock()  # //archilab
name_7 = Family.Name(family=filterByBoolMask.in)

# group: Separar Entradas
code_block_8 = CodeBlock { 1; }
getItemAtIndex = List.GetItemAtIndex(list=multipleinputform.User_Inputs, index=code_block_8)
code_block_9 = CodeBlock { 0; }
getItemAtIndex_2 = List.GetItemAtIndex(list=multipleinputform.User_Inputs, index=code_block_9)
code_block_10 = CodeBlock { 2; }
getItemAtIndex_3 = List.GetItemAtIndex(list=multipleinputform.User_Inputs, index=code_block_10)
code_block_11 = CodeBlock { 3; }
getItemAtIndex_4 = List.GetItemAtIndex(list=multipleinputform.User_Inputs, index=code_block_11)

# group: Family Type
family = FamilyType.Family(familyType=getItemAtIndex)
types_3 = Family.Types(family=family)
name_8 = FamilyType.Name(familyType=getItemAtIndex)
name_9 = FamilyType.Name(familyType=types_3)
eq = name_8 == name_9
filterByBoolMask_4 = List.FilterByBoolMask(list=types_3, mask=eq)

# group: Filtrar os caminhos de cabos em função do comprimento mínimo
getLocation = Element.GetLocation(element=getItemAtIndex_2)
length = Curve.Length(curve=getLocation)
gt = length > getItemAtIndex_3
filterByBoolMask_5 = List.FilterByBoolMask(list=length, mask=gt)

filterByBoolMask_6 = List.FilterByBoolMask(list=getLocation, mask=gt)

# group: Definindo o espaçamento
code_block_12 = CodeBlock(y=filterByBoolMask_5.in) { casas_decimais = 2; list = DSCore.Math.Ceiling(y*casas_decimais)/casas_decimais; }
code_block_13 = CodeBlock(full_len=code_block_12.list, inset=getItemAtIndex_3, max_spacing=getItemAtIndex_4) { len = full_len - inset; count = len/max_spacing; req_count = DSCore.Math.Ceiling(count); spacing = len/req_count; }
code_block_14 = CodeBlock(inset=getItemAtIndex_3, count=code_block_13.count, spacing=code_block_13.spacing) { inset..count*spacing..#count; }

code_block_15 = CodeBlock { 0.2; }
python_script = Python(IN[0]=code_block_14, IN[1]=code_block_15)
# ---------- python_script.python (15 lines) ----------
# Carregar as bibliotecas DesignScript e padrão do Python
import sys
import clr
clr.AddReference('ProtoGeometry')
from Autodesk.DesignScript.Geometry import *

# Entradas
valores = IN[0]  # Lista de valores (alguns podem ser null)
replace = IN[1]  # Valor para substituir os valores null

# Função para substituir valores null
valores_substituidos = [replace if val is None else val for val in valores]

# Saída
OUT = valores_substituidos
# ----------------------------------------

# group: Obtendo os pontos de posicionamento
pointAtSegmentLength = Curve.PointAtSegmentLength(curve=filterByBoolMask_6.in, segmentLength=python_script)
parameterAtPoint = Curve.ParameterAtPoint(curve=getLocation, point=pointAtSegmentLength)
normalAtParameter = Curve.NormalAtParameter(curve=getLocation, param=parameterAtPoint)

# group: Criando as famílias de suportes
byPoint = FamilyInstance.ByPoint(familyType=filterByBoolMask_4.in, point=pointAtSegmentLength, lacing=Longest)

# group: Obtendo os parâmetros
code_block_16 = CodeBlock { "Diâmetro (tamanho comercial)"; "Largura"; "Altura"; }
getParameterValueByName = Element.GetParameterValueByName(element=getItemAtIndex_2, parameterName=code_block_16.out0)
convert_between_units = DynamoConvert(getParameterValueByName, MeasurementType="Length", FromConversion="Millimeters", ToConversion="Meters")
getParameterValueByName_2 = Element.GetParameterValueByName(element=getItemAtIndex_2, parameterName=code_block_16.out1)
convert_between_units_2 = DynamoConvert(getParameterValueByName_2, MeasurementType="Length", FromConversion="Millimeters", ToConversion="Meters")
getParameterValueByName_3 = Element.GetParameterValueByName(element=getItemAtIndex_2, parameterName=code_block_16.out2)
convert_between_units_3 = DynamoConvert(getParameterValueByName_3, MeasurementType="Length", FromConversion="Millimeters", ToConversion="Meters")

# group: Parâmetro da família DN
code_block_17 = CodeBlock { "DN"; }
setParameterByName = Element.SetParameterByName(element=byPoint, parameterName=code_block_17, value=convert_between_units)

# group: Parâmetro da família Largura
code_block_18 = CodeBlock { "Largura"; }
setParameterByName_2 = Element.SetParameterByName(element=byPoint, parameterName=code_block_18, value=convert_between_units_2)

# group: Parâmetro da família Altura
code_block_19 = CodeBlock { "Altura"; }
setParameterByName_3 = Element.SetParameterByName(element=byPoint, parameterName=code_block_19, value=convert_between_units_3)

# group: Intersecção com a laje
location = FamilyInstance.Location(familyInstance=byPoint)
X = Point.X(point=location)
Y = Point.Y(point=location)
Z = Point.Z(point=location)
code_block_20 = CodeBlock { 3; }
add_2 = Z + code_block_20
byCoordinates = Point.ByCoordinates(x=X, y=Y, z=add_2)
code_block_21 = CodeBlock { 0.05; }
byPointsRadius = Cone.ByPointsRadius(startPoint=location, endPoint=byCoordinates, startRadius=code_block_21)
categories_5 = Categories("OST_Floors")
all_elements_of_category = ElementsOfCategory(Category=categories_5)
intersectsSolid = Revit.Element.IntersectsSolid(solids=byPointsRadius, elements=all_elements_of_category)
intersectingElements = Results.SolidIntersectionResult.IntersectingElements(solidIntersectionResult=intersectsSolid)
firstItem = List.FirstItem(list=intersectingElements@L2)
code_block_22 = CodeBlock { "Elevação na parte inferior"; }
getParameterValueByName_4 = Element.GetParameterValueByName(element=firstItem, parameterName=code_block_22)
abs = Math.Abs(number=getParameterValueByName_4)
code_block_23 = CodeBlock { "Elevação do nível"; }
getParameterValueByName_5 = Element.GetParameterValueByName(element=byPoint, parameterName=code_block_23)
abs_2 = Math.Abs(number=getParameterValueByName_5)
sub = abs - abs_2

# group: Parâmetro da família Distância até o Teto
code_block_24 = CodeBlock { "Distância até o Teto"; }
abs_3 = Math.Abs(number=sub)
setParameterByName_4 = Element.SetParameterByName(element=byPoint, parameterName=code_block_24, value=abs_3)

# group: Ângulo de orientação
X_2 = Vector.X(vector=normalAtParameter)
code_block_25 = CodeBlock { 0.0; 0.001; }
eq_2 = Equals(x=X_2, y=code_block_25.out0, tolerance=code_block_25.out1)
reverse = Vector.Reverse(vector=normalAtParameter)

ge = X_2 >= code_block_25.out0

# group (continued): Ângulo de orientação
if_ = If(test=ge, true=normalAtParameter, false=reverse)
code_block_26 = CodeBlock(Vector1=if_) { Vector.YAxis(); Vector1; Vector.XAxis(); }
angleAboutAxis = Vector.AngleAboutAxis(vector=code_block_26.Vector1, otherVector=code_block_26.out0, rotationAxis=code_block_26.out2)
round = Math.Round(number=angleAboutAxis)

# group: Parâmetro da família - Ângulo
setRotation = FamilyInstance.SetRotation(familyInstance=byPoint, degree=round)

# group: Mensagem Final
flatten_8 = List.Flatten(list=setRotation)
count = List.Count(list=flatten_8)
code_block_27 = CodeBlock { 0; }
gt_2 = count > code_block_27
code_block_28 = CodeBlock(N=count) { ["Feito! você inseriu "+N+" Suportes"]; }
code_block_29 = CodeBlock { ["Nenhum Suporte foi inserido"]; }
if_2 = If(test=gt_2, true=code_block_28, false=code_block_29)
flatten_9 = List.Flatten(list=if_2)

fromList = Python(IN[0]=flatten_9)  # "String.FromList"
# ---------- fromList.python (22 lines) ----------
# Carregar as bibliotecas DesignScript e padrão do Python
import sys
import clr
clr.AddReference('ProtoGeometry')
from Autodesk.DesignScript.Geometry import *

# Função para concatenar os valores de uma lista em uma única string com múltiplas linhas
def concatenate_list_to_string(input_list, delimiter="\n"):
    # Verifica se a entrada é uma lista
    if not isinstance(input_list, list):
        return "A entrada deve ser uma lista."
    
    # Converte todos os elementos para string e junta com o delimitador especificado
    result = delimiter.join(str(item) for item in input_list)
    return result

# Entrada pelo nó do Dynamo
lista = IN[0]  # Lista de valores a serem concatenados
delimitador = IN[1] if len(IN) > 1 else "\n"  # Delimitador opcional, padrão é nova linha

# Saída para o Dynamo
OUT = concatenate_list_to_string(lista, delimitador)
# ----------------------------------------

# group (continued): Mensagem Final
python_script_2 = Python(IN[0]=fromList)
# ---------- python_script_2.python (21 lines) ----------
# Importar as bibliotecas necessárias do Revit
import clr
clr.AddReference("RevitServices")
from RevitServices.Persistence import DocumentManager

clr.AddReference("RevitAPI")
clr.AddReference("RevitAPIUI")
from Autodesk.Revit.UI import TaskDialog

# Pegar a entrada do Dynamo
mensagem = IN[0]

# Criar a TaskDialog
task_dialog = TaskDialog("Ok")
task_dialog.MainInstruction = mensagem

# Exibir a TaskDialog
task_dialog.Show()

# Saída do script
OUT = "Sucesso!"
# ----------------------------------------

le = X_2 <= code_block_25.out0

# group: Intersecção com a parede
location_2 = FamilyInstance.Location(familyInstance=byPoint)
code_block_30 = CodeBlock { 0.1; 2; 0.1; }
byLengths = Cuboid.ByLengths(origin=location_2, width=code_block_30.out0, length=code_block_30.out1, height=code_block_30.out2)
categories_6 = Categories("OST_Walls")
all_elements_of_category_2 = ElementsOfCategory(Category=categories_6)
intersectsSolid_2 = Revit.Element.IntersectsSolid(solids=byLengths, elements=all_elements_of_category_2)
intersectingElements_2 = Results.SolidIntersectionResult.IntersectingElements(solidIntersectionResult=intersectsSolid_2)
solids = Element.Solids(element=intersectingElements_2)
distanceTo = Geometry.DistanceTo(geometry=solids, other=location_2)
abs_4 = Math.Abs(number=distanceTo)

# group: Parâmetro da família Distância até a parede
code_block_31 = CodeBlock { "Dist. Parede"; }
setParameterByName_5 = Element.SetParameterByName(element=byPoint, parameterName=code_block_31, value=abs_4)

watch = Watch(python_script)
