# Dynamo graph 13-0_BIMACON_Gerar Legenda Simbologia_script.dyn "13-0_BIMACON_Gerar Legenda Simbologia" (Dynamo 2.6.1.8786)

categories = Categories("OST_LightingDevices")
categories_2 = Categories("OST_ElectricalFixtures")
categories_3 = Categories("OST_MechanicalEquipment")
categories_4 = Categories("OST_LightingFixtures")
categories_5 = Categories("OST_ElectricalEquipment")
categories_6 = Categories("OST_ConduitFitting")
list_create = List.Create(item0=categories, item1=categories_2, item2=categories_3, item3=categories_4, item4=categories_5, item5=categories_6)
all_elements_of_category = ElementsOfCategory(Category=list_create)
flatten = List.Flatten(list=all_elements_of_category)
getFamily = FamilyInstance.GetFamily(familyInstance=flatten)
flatten_2 = List.Flatten(list=getFamily)
string_from_object = FromObject(obj=flatten_2)
code_block = CodeBlock { ["Ponto de Força"]; }
contains = String.Contains(str=string_from_object@L2, searchFor=code_block, lacing=Longest)
filterByBoolMask = List.FilterByBoolMask(list=flatten@L2, mask=contains@L2)
code_block_2 = CodeBlock { ["Interruptor"]; }
contains_2 = String.Contains(str=string_from_object@L2, searchFor=code_block_2, lacing=Longest)
filterByBoolMask_2 = List.FilterByBoolMask(list=flatten@L2, mask=contains_2@L2)
code_block_3 = CodeBlock { ["Tomada"]; }
contains_3 = String.Contains(str=string_from_object@L2, searchFor=code_block_3, lacing=Longest)
filterByBoolMask_3 = List.FilterByBoolMask(list=flatten@L2, mask=contains_3@L2)
code_block_4 = CodeBlock { ["Ar condicionado"]; }
contains_4 = String.Contains(str=string_from_object@L2, searchFor=code_block_4, lacing=Longest)
filterByBoolMask_4 = List.FilterByBoolMask(list=flatten@L2, mask=contains_4@L2)
code_block_5 = CodeBlock { ["Caixa passagem"]; }
contains_5 = String.Contains(str=string_from_object@L2, searchFor=code_block_5, lacing=Longest)
filterByBoolMask_5 = List.FilterByBoolMask(list=flatten@L2, mask=contains_5@L2)
code_block_6 = CodeBlock { ["Sensor"]; }
contains_6 = String.Contains(str=string_from_object@L2, searchFor=code_block_6, lacing=Longest)
filterByBoolMask_6 = List.FilterByBoolMask(list=flatten@L2, mask=contains_6@L2)
code_block_7 = CodeBlock { ["Dimer"]; }
contains_7 = String.Contains(str=string_from_object@L2, searchFor=code_block_7, lacing=Longest)
filterByBoolMask_7 = List.FilterByBoolMask(list=flatten@L2, mask=contains_7@L2)
code_block_8 = CodeBlock { ["Luminária"]; }
contains_8 = String.Contains(str=string_from_object@L2, searchFor=code_block_8, lacing=Longest)
filterByBoolMask_8 = List.FilterByBoolMask(list=flatten@L2, mask=contains_8@L2)
code_block_9 = CodeBlock { ["Campainha"]; }
contains_9 = String.Contains(str=string_from_object@L2, searchFor=code_block_9, lacing=Longest)
filterByBoolMask_9 = List.FilterByBoolMask(list=flatten@L2, mask=contains_9@L2)
code_block_10 = CodeBlock { ["Relé"]; }
contains_10 = String.Contains(str=string_from_object@L2, searchFor=code_block_10, lacing=Longest)
filterByBoolMask_10 = List.FilterByBoolMask(list=flatten@L2, mask=contains_10@L2)
code_block_11 = CodeBlock { ["Caixa"]; }
contains_11 = String.Contains(str=string_from_object@L2, searchFor=code_block_11, lacing=Longest)
filterByBoolMask_11 = List.FilterByBoolMask(list=flatten@L2, mask=contains_11@L2)
code_block_12 = CodeBlock { ["Quadro"]; }
contains_12 = String.Contains(str=string_from_object@L2, searchFor=code_block_12, lacing=Longest)
filterByBoolMask_12 = List.FilterByBoolMask(list=flatten@L2, mask=contains_12@L2)
list_create_2 = List.Create(item0=filterByBoolMask.in, item1=filterByBoolMask_2.in, item2=filterByBoolMask_3.in, item3=filterByBoolMask_4.in, item4=filterByBoolMask_5.in, item5=filterByBoolMask_6.in, item6=filterByBoolMask_7.in, item7=filterByBoolMask_8.in, item8=filterByBoolMask_9.in, item9=filterByBoolMask_10.in, item10=filterByBoolMask_11.in, item11=filterByBoolMask_12.in)
flatten_3 = List.Flatten(list=list_create_2)
watch = Watch(flatten_3)
code_block_13 = CodeBlock { "Imagem"; }

# group: Ler do Excel
file_path = Filename("..\..\..\..\..\00 - BIMACON TREINAMENTOS\02 - Padrão CEMIG no Revit\SIMBOLOGIA\SIMBOLOGIA ELÉTRICA EXPORTAR.xlsx")  # graph input
fromPath = FileObject(path=file_path)  # "File.FromPath"
code_block_14 = CodeBlock { "SIMBOLOGIA ELÉTRICA EXPORTAR"; }
code_block_15 = CodeBlock { true; }
boolean = BoolSelector(false)
importExcel = Data.ImportExcel(file=fromPath, sheetName=code_block_14, readAsStrings=code_block_15, showExcel=boolean)
transpose = List.Transpose(lists=importExcel)
code_block_16 = CodeBlock { 0; }
removeItemAtIndex = List.RemoveItemAtIndex(list=transpose, indices=code_block_16, lacing=Longest)

# group: Encontre a imagem certa para o nome certo
element_types = ElementTypes("ImageType")  # graph input
all_elements_of_type = ElementsOfType(element_type=element_types)
code_block_17 = CodeBlock(list=removeItemAtIndex) { list[3]; }
code_block_18 = CodeBlock { "Nome do tipo"; }
getParameterValueByName = Element.GetParameterValueByName(element=all_elements_of_type, parameterName=code_block_18)
eq = code_block_17@L1 == getParameterValueByName
filterByBoolMask_13 = List.FilterByBoolMask(list=all_elements_of_type@L2, mask=eq, lacing=Longest)
flatten_4 = List.Flatten(list=filterByBoolMask_13.in)

code_block_19 = CodeBlock { "Bimacon_Legenda"; }
getParameterValueByName_2 = Element.GetParameterValueByName(element=flatten_3, parameterName=code_block_19)

# group: Regra para o Tipo
code_block_20 = CodeBlock { "Tipo"; }
getParameterValueByName_3 = Element.GetParameterValueByName(element=flatten_3, parameterName=code_block_20)
string_from_object_2 = FromObject(obj=getParameterValueByName_3)
code_block_21 = CodeBlock { "Family Type: "; }
code_block_22 = CodeBlock { ""; }
replace = String.Replace(str=string_from_object_2, searchFor=code_block_21, replaceWith=code_block_22)
code_block_23 = CodeBlock { ","; }
split = String.Split(str=replace, separator0=code_block_23)
code_block_24 = CodeBlock { 0; }
getItemAtIndex = List.GetItemAtIndex(list=split, index=code_block_24, lacing=Longest)
code_block_25 = CodeBlock(list=removeItemAtIndex) { list[2]; }
eq_2 = getParameterValueByName_2@L1 == code_block_25

filterByBoolMask_14 = List.FilterByBoolMask(list=flatten_4@L2, mask=eq_2, lacing=Longest)
setParameterByName = Element.SetParameterByName(element=watch@L2, parameterName=code_block_13, value=filterByBoolMask_14.in)
flatten_5 = List.Flatten(list=filterByBoolMask_14.in)
flatten_6 = List.Flatten(list=list_create_2)
filterByBoolMask_15 = List.FilterByBoolMask(list=getParameterValueByName@L2, mask=eq, lacing=Longest)
flatten_7 = List.Flatten(list=filterByBoolMask_15.in)
code_block_26 = CodeBlock { ["Tomada"]; }
