# Dynamo graph BIMACON_Deleta Familias com extensão 1_R00_script.dyn "BIMACON_Deleta Familias com extensão 1_script" (Dynamo 2.6.1.8786)
# packages: archi-lab.net 2023.213.1722, Orchid 2.6.10.6373, Data-Shapes 2022.2.105, Genius Loci 2023.2.21

element_types = ElementTypes("Family")
all_elements_of_type = ElementsOfType(element_type=element_types)
flatten = List.Flatten(list=all_elements_of_type)
uniqueItems = List.UniqueItems(list=flatten)
name = Family.Name(family=uniqueItems)
code_block = CodeBlock { "1"; }
contains = String.Contains(str=name, searchFor=code_block)
filterByBoolMask = List.FilterByBoolMask(list=uniqueItems, mask=contains)
name_2 = Family.Name(family=filterByBoolMask.in)
code_block_2 = CodeBlock { 600; }

# group: SELECIONE O MODELO ARQ LINKADO
code_block_3 = CodeBlock { "Selecione as famílias a serem deletadas"; }
file_path = Filename("..\..\..\..\..\05 - BIMACON\01 - EMPRESA BIMACON\00 - Logos e imagens - BIMACON\ARTE BIMACON\reddonda-removebg-preview.png")
file_from_path = FileObject(path=file_path)
readFromFile = Image.ReadFromFile(file=file_from_path)
string = StringInput("Confirmar")
listview_data = Custom[Listview Data](Keys=name_2, Values=filterByBoolMask.in)  # package Data-Shapes; Create data for ListView input in UI.MultiInputForm ++ . Check out www.data-shapes.net for more infos.
list_create = List.Create(item0=listview_data)
boolean = BoolSelector(true)
string_2 = StringInput("Cancelar")
multipleinputform = Custom[MultipleInputForm ++](Description_optional=code_block_3, Logo_optional=readFromFile, ButtonText_optional=string, Inputs=list_create, Toggle=boolean, CancelButtonText_optional=string_2, Width_optional=code_block_2)  # package Data-Shapes; Create a form with multiple inputs. see www.data-shapes.net for tutorials and infos!
code_block_4 = CodeBlock()  # //Data-Shapes
get_alldocuments = Custom[Get AllDocuments]()  # package Genius Loci; Get documents (linked and opened in background). The first document is the active document.
code_block_5 = CodeBlock()  # //archilab

code_block_6 = CodeBlock { 0; }
getItemAtIndex = List.GetItemAtIndex(list=multipleinputform.User_Inputs, index=code_block_6)
delete = archilab.Revit.Elements.Elements.Delete(element=getItemAtIndex)

# group: Mensagem Final
countTrue = List.CountTrue(list=delete)
code_block_7 = CodeBlock { 0; }
gt = countTrue > code_block_7
code_block_8 = CodeBlock(N=countTrue) { [""+N+" elementos foram deletados"]; }
code_block_9 = CodeBlock { ["Nenhum elemento deletado"]; }
if_ = If(test=gt, true=code_block_8, false=code_block_9)
flatten_2 = List.Flatten(list=if_)
o_string_fromlist = Orchid.Common.String.FromList(list=flatten_2)
python_script = Python(IN[0]=o_string_fromlist)
# ---------- python_script.python (21 lines) ----------
# Importar as bibliotecas necessárias do Revit
import clr
clr.AddReference("RevitServices")
from RevitServices.Persistence import DocumentManager

clr.AddReference("RevitAPI")
clr.AddReference("RevitAPIUI")
from Autodesk.Revit.UI import TaskDialog

# Pegar a entrada do Dynamo
mensagem = IN[0]

# Criar a TaskDialog
task_dialog = TaskDialog("Ok")
task_dialog.MainInstruction = mensagem

# Exibir a TaskDialog
task_dialog.Show()

# Saída do script
OUT = "Sucesso!"
# ----------------------------------------
